# Grasshopper definition 190309_Serialization_Example_0.gh (Grasshopper 1.0.7)

mesh = Mesh([<mesh referenced from the Rhino model> x11])
mesh_2 = Mesh(null)
merge = Merge(Data1=mesh, Data2=mesh_2)
# Tile
# Meshes
mesh_3 = Mesh(merge)
lng = ListLength(List=mesh_3)
int = Integer(-2)
# Notes: Centers each tile at the origin
# 
# This may need to be revised for different imported tile sets
series = Series(Start=0, Step=int, Count=lng)
vec = VectorXYZ(XComponent=series, YComponent=0, ZComponent=0)  # -> Vector, Length
# Tile
# Graph
panel = Panel("C:\Users\David\Google Drive\Dev\RC3-Sandbox-2018\Rhino\IO\graph_0")
move = Move(Geometry=mesh_3, Motion=vec.Vector)  # -> Geometry, Transform
yz = YZPlane(Origin=Point(0, 0, 0))
mirror = Mirror(Geometry=move.Geometry, Plane=yz)  # -> Geometry, Transform
xy = XYPlane(Origin=Point(0, 0, 0))

# ---- group: Deserialize TileGraph
c_script = CSharpScript(path=panel)  # -> out, adjacency, degree, positions; inputs path: String
# ---------- c_script: C# usings ----------
using System.Linq;

using System.IO;
using System.Runtime.Serialization.Formatters.Binary;
# ---------- c_script: C# ----------
    var obj = DeserializeBinary(path);
    var data = (Tuple<int[], int, float[]>) obj;

    adjacency = data.Item1;
    degree = data.Item2;
    positions = data.Item3;
# ---------- c_script: C# additional code ----------
  /// <summary>
  ///
  /// </summary>
  public static object DeserializeBinary(string path)
  {
    using (Stream stream = new FileStream(path, FileMode.Open, FileAccess.Read, FileShare.Read))
    {
      var formatter = new BinaryFormatter();
      return formatter.Deserialize(stream);
    }
  }
# ---------- end c_script ----------

# ----
mirror_2 = Mirror(Geometry=mirror.Geometry, Plane=xy)  # -> Geometry, Transform
mesh_4 = Mesh(mirror_2.Geometry)
partition = PartitionList(List=c_script.adjacency, Size=c_script.degree)
num2pt = NumbersToPoints(Numbers=c_script.positions, Mask="XZY")
pt = Point(num2pt)
# Tile
# Model
# History
panel_2 = Panel("C:\Users\David\Google Drive\Dev\RC3-Sandbox-2018\Rhino\IO\model_history_0")

# ---- group: Deserialize TileModel
c_script_2 = CSharpScript(path=panel_2)  # -> out, result; inputs path: String
# ---------- c_script_2: C# ----------
    result = (List<int[]>) DeserializeBinary(path);
# ---------- c_script_2: C# additional code ----------
  /// <summary>
  /// Binary deserialization
  /// </summary>
  /// <param name="path"></param>
  /// <returns></returns>
  public static object DeserializeBinary(string path)
  {
    using (Stream stream = new FileStream(path, FileMode.Open, FileAccess.Read, FileShare.Read))
    {
      var formatter = new BinaryFormatter();
      return formatter.Deserialize(stream);
    }
  }
# ---------- end c_script_2 ----------

# ----
# Tile
# Model
panel_3 = Panel("C:\Users\David\Google Drive\Dev\RC3-Sandbox-2018\Rhino\IO\model_0")

# ---- group: Explode Tile Model
c_script_3 = CSharpScript(data=c_script_2.result)  # -> out, result
# ---------- c_script_3: C# ----------
    result = (int[]) data;
# ---------- end c_script_3 ----------

# ---- group: Deserialize TileModel
c_script_4 = CSharpScript(path=panel_3)  # -> out, result; inputs path: String
# ---------- c_script_4: C# usings ----------
using System.IO;
using System.Runtime.Serialization.Formatters.Binary;
# ---------- c_script_4: C# ----------
    result = DeserializeBinary(path);
# ---------- c_script_4: C# additional code ----------
  /// <summary>
  /// Binary deserialization
  /// </summary>
  /// <param name="path"></param>
  /// <returns></returns>
  public static object DeserializeBinary(string path)
  {
    using (Stream stream = new FileStream(path, FileMode.Open, FileAccess.Read, FileShare.Read))
    {
      var formatter = new BinaryFormatter();
      return formatter.Deserialize(stream);
    }
  }
# ---------- end c_script_4 ----------

# ---- group: Tile Meshes
mesh_5 = Mesh(mesh_4)

# ----
lng_2 = ListLength(List=c_script_2.result)

# ---- group: Tile Meshes
mesh_6 = Mesh(mesh_4)

# ----
item = ListItem(List=mesh_5, Index=c_script_3.result, Wrap=True)
series_2 = Series(Start=0, Step=Slider(17, range=0..100), Count=lng_2)
vec_2 = Vector(pt)
item_2 = ListItem(List=mesh_6, Index=c_script_4.result, Wrap=True)
vec_3 = Vector(pt)
vec_4 = VectorXYZ(XComponent=series_2, YComponent=0, ZComponent=0)  # -> Vector, Length
move_2 = Move(Geometry=item, Motion=vec_2)  # -> Geometry, Transform
move_3 = Move(Geometry=item_2, Motion=vec_3)  # -> Geometry, Transform
move_4 = Move(Geometry=move_2.Geometry, Motion=graft(vec_4.Vector))  # -> Geometry, Transform
mesh_7 = Mesh(move_3.Geometry)
mesh_8 = Mesh(move_4.Geometry)
