# Grasshopper definition 190309_Serialization_Example_1.gh (Grasshopper 1.0.7)

# ---- group: Tile Set 1
mesh = Mesh([<mesh referenced from the Rhino model> x12])

# ----
bool = Boolean(Button())

# ----
# Tile
# Meshes
mesh_2 = Mesh(mesh)
lng = ListLength(List=mesh_2)
num = Number(-1.5)
# Notes: Centers each tile at the origin
# 
# This may need to be revised for different imported tile sets
series = Series(Start=0, Step=num, Count=lng)
vec = VectorXYZ(XComponent=series, YComponent=0, ZComponent=0)  # -> Vector, Length
# Tile
# Graph
panel = Panel("C:\Users\David\Google Drive\Dev\RC3-Sandbox-2018\Rhino\IO\graph_1")
move = Move(Geometry=mesh_2, Motion=vec.Vector)  # -> Geometry, Transform
mesh_3 = Mesh(null)
bool_2 = Boolean(bool)
ins = InsertItems(List=move.Geometry, Item=mesh_3, Indices=0, Wrap=True)

# ---- group: Deserialize TileGraph
c_script = CSharpScript(path=panel, refresh=bool_2)  # -> out, adjacency, degree, positions; inputs path: String
# ---------- c_script: C# usings ----------
using System.Linq;

using System.IO;
using System.Runtime.Serialization.Formatters.Binary;
# ---------- c_script: C# ----------
    var obj = DeserializeBinary(path);
    var data = (Tuple<int[], int, float[]>) obj;

    adjacency = data.Item1;
    degree = data.Item2;
    positions = data.Item3;
# ---------- c_script: C# additional code ----------
  /// <summary>
  ///
  /// </summary>
  public static object DeserializeBinary(string path)
  {
    using (Stream stream = new FileStream(path, FileMode.Open, FileAccess.Read, FileShare.Read))
    {
      var formatter = new BinaryFormatter();
      return formatter.Deserialize(stream);
    }
  }
# ---------- end c_script ----------

# ----
mesh_4 = Mesh(ins)
num2pt = NumbersToPoints(Numbers=c_script.positions, Mask=4)
partition = PartitionList(List=c_script.adjacency, Size=c_script.degree)
pt = Point(num2pt)
# Tile
# Model
# History
panel_2 = Panel("C:\Users\David\Google Drive\Dev\RC3-Sandbox-2018\Rhino\IO\model_history_1")
bool_3 = Boolean(bool)

# ---- group: Deserialize TileModel
c_script_2 = CSharpScript(path=panel_2, refresh=bool_3)  # -> out, result; inputs path: String
# ---------- c_script_2: C# ----------
    result = (List<int[]>) DeserializeBinary(path);
# ---------- c_script_2: C# additional code ----------
  /// <summary>
  /// Binary deserialization
  /// </summary>
  /// <param name="path"></param>
  /// <returns></returns>
  public static object DeserializeBinary(string path)
  {
    using (Stream stream = new FileStream(path, FileMode.Open, FileAccess.Read, FileShare.Read))
    {
      var formatter = new BinaryFormatter();
      return formatter.Deserialize(stream);
    }
  }
# ---------- end c_script_2 ----------

# ----
# Tile
# Model
panel_3 = Panel("C:\Users\David\Google Drive\Dev\RC3-Sandbox-2018\Rhino\IO\model_1")
bool_4 = Boolean(bool)

# ---- group: Explode Tile Model
c_script_3 = CSharpScript(data=c_script_2.result)  # -> out, result
# ---------- c_script_3: C# ----------
    result = (int[]) data;
# ---------- end c_script_3 ----------

# ---- group: Deserialize TileModel
c_script_4 = CSharpScript(path=panel_3, refresh=bool_4)  # -> out, result; inputs path: String
# ---------- c_script_4: C# usings ----------
using System.IO;
using System.Runtime.Serialization.Formatters.Binary;
# ---------- c_script_4: C# ----------
    result = DeserializeBinary(path);
# ---------- c_script_4: C# additional code ----------
  /// <summary>
  /// Binary deserialization
  /// </summary>
  /// <param name="path"></param>
  /// <returns></returns>
  public static object DeserializeBinary(string path)
  {
    using (Stream stream = new FileStream(path, FileMode.Open, FileAccess.Read, FileShare.Read))
    {
      var formatter = new BinaryFormatter();
      return formatter.Deserialize(stream);
    }
  }
# ---------- end c_script_4 ----------

# ---- group: Tile Meshes
mesh_5 = Mesh(mesh_4)

# ----
lng_2 = ListLength(List=c_script_2.result)

# ---- group: Tile Meshes
mesh_6 = Mesh(mesh_4)

# ----
item = ListItem(List=mesh_5, Index=c_script_3.result, Wrap=True)
series_2 = Series(Start=0, Step=Slider(10, range=0..100), Count=lng_2)
vec_2 = Vector(pt)
item_2 = ListItem(List=mesh_6, Index=c_script_4.result, Wrap=True)
vec_3 = Vector(pt)
vec_4 = VectorXYZ(XComponent=series_2, YComponent=0, ZComponent=0)  # -> Vector, Length
move_2 = Move(Geometry=item, Motion=vec_2)  # -> Geometry, Transform
move_3 = Move(Geometry=item_2, Motion=vec_3)  # -> Geometry, Transform
move_4 = Move(Geometry=move_2.Geometry, Motion=graft(vec_4.Vector))  # -> Geometry, Transform
mesh_7 = Mesh(move_3.Geometry)
mesh_8 = Mesh(move_4.Geometry)
