# Grasshopper definition 190309_Tensegrity_Example_0.gh (Grasshopper 1.0.7)
# plug-ins: Human, Kangaroo2 Components

polygon = Polygon(Plane=PlaneXY(0, 0, 0), Radius=3, Segments=Slider(8, range=0..10), FilletRadius=0)  # -> Polygon, Length
explode = Explode(Curve=polygon.Polygon, Recursive=True)  # -> Segments, Vertices
move = Move(Geometry=polygon.Polygon, Motion=Vector(0, 0, 10))  # -> Geometry, Transform
cull_i = CullIndex(List=explode.Vertices, Indices=-1, Wrap=True)
explode_2 = Explode(Curve=move.Geometry, Recursive=True)  # -> Segments, Vertices
cull_i_2 = CullIndex(List=explode_2.Vertices, Indices=-1, Wrap=True)
shift = ShiftList(List=cull_i_2, Shift=1, Wrap=True)
ln = Line(StartPoint=cull_i, EndPoint=cull_i_2)
ln_2 = Line(StartPoint=cull_i, EndPoint=shift)

# ---- group: Primitive A-1
crv = Curve([<curve referenced from the Rhino model> x96])
crv_2 = Curve([<curve referenced from the Rhino model> x24])

# ---- group: Primitive A
crv_3 = Curve([<curve referenced from the Rhino model> x6])
crv_4 = Curve([<curve referenced from the Rhino model> x24])

# ----
merge = Merge(Data1=flatten(explode.Segments), Data2=flatten(explode_2.Segments), Data3=flatten(ln_2))

# ---- group: Primitive B
line = Line(ln)
line_2 = Line(merge)

# ---- group: Tension
crv_5 = Curve(flatten(crv))

# ----
len = Length(Curve=crv_5)

# ---- group: Compression
crv_6 = Curve(flatten(crv_2))

# ----
multiplication = Multiplication(A=len, B=Slider(0.442, range=0..1))
length_line = LengthLine(Line=crv_6, Strength=Slider(10000, range=0..10000))
length_line_2 = LengthLine(Line=crv_5, Length=multiplication, Strength=Slider(44.85, range=0..100))
lng = ListLength(List=crv_6)
merge_2 = Merge(Data1=length_line, Data2=length_line_2)
bouncysolver = BouncySolver(
    GoalObjects=merge_2,
    Reset=Button(),
    Threshold=1e-15,
    Tolerance=0.01,
    Damping=0.99,
    Iterations=Slider(10, range=0..10),
    On=Toggle(False))  # -> I, V, O
split = SplitList(List=bouncysolver.O, Index=lng)  # -> ListA, ListB
previewlw = CustomPreviewLineweights(Geometry=split.ListA, Shader=ColourSwatch(SwatchColor=RGB(255, 0, 0)), Thickness=Slider(10, range=0..10), Absolute=False)
previewlw_2 = CustomPreviewLineweights(
    Geometry=split.ListB,
    Shader=ColourSwatch(SwatchColor=RGB(0, 162, 255)),
    Thickness=Slider(3, range=0..10),
    Absolute=False)
