# Grasshopper definition 190428_MeshBump_Example_0.gh (Grasshopper 1.0.7)
# plug-ins: SpatialSlur.SlurGH, Weaverbird

crv = Curve([<curve referenced from the Rhino model> x3])
crv_2 = Curve([<curve referenced from the Rhino model> x3])
loft = MeshLoft(Polylines=crv)
loft_2 = MeshLoft(Polylines=crv_2)
mjoin = MeshJoin(Meshes=[loft_2, loft])
wbcatmullclark = WeaverbirdsCatmullClarkSubdivision(MeshCurves=mjoin, Level=3, SmoothNakedEdges=2)
wbcatmullclark_2 = WeaverbirdsCatmullClarkSubdivision(MeshCurves=wbcatmullclark, Level=3, SmoothNakedEdges=2)

# ---- group: Base Surface
mesh = Mesh(wbcatmullclark_2)

# ---- group: Generate Field
number_slider = Slider(0, range=0..1)
mesh_2 = Mesh(mesh)
demesh = DeconstructMesh(Mesh=mesh_2)  # -> Vertices, Faces, Colours, Normals
merge = Merge(Data1=number_slider, Data2=Slider(1, range=0..1), Data3=number_slider)
dup = DuplicateData(Data=merge, Number=Slider(9, range=0..10), Order=True)
pdecon = Deconstruct(Point=demesh.Normals)  # -> XComponent, YComponent, ZComponent
interp = InterpolateData(Data=dup, Parameter=pdecon.XComponent, Interpolation=4)
num = Number(interp)

# ----
mesh_3 = Mesh(mesh)
num_2 = Number(num)
demesh_2 = DeconstructMesh(Mesh=mesh_3)  # -> Vertices, Faces, Colours, Normals
amp = Amplitude(Vector=demesh_2.Normals, Amplitude=num_2)
move = Move(Geometry=demesh_2.Vertices, Motion=amp)  # -> Geometry, Transform
conmesh = ConstructMesh(Vertices=move.Geometry, Faces=demesh_2.Faces)
